# Dynamo graph Check json Topology.dyn (Dynamo 3.5.2.8914)
# packages: Data-Shapes 2025.3.120, archi-lab.net 2025.300.1225

file_path = Filename(".\topologic_results.json")
python_script = Python(IN[0]=file_path)  # CPython3
# ---------- python_script.python (209 lines) ----------
# Dynamo Python: Robust visualization of topologic_results.json
# Compatible with IronPython2 and CPython3 engines.
#
# IN[0] : File path to topologic_results.json
#
# OUT indexes:
# 0 messages (list of strings)
# 1 meta dict (or {})
# 2 element_ids_str (list of element_id as STRING)
# 3 element_ids_int (list of element_id as INT or None where not numeric)
# 4 lengths (list, float or None)
# 5 path_points (list of lists of DS Points)
# 6 path_polycurves (list of PolyCurve or None)
# 7 id_to_length_dict (keys are STRING)
# 8 success_count
# 9 failure_count
# 10 merged_polycurve (single PolyCurve of all path segments or None)
#
import json, os, sys, traceback

# Geometry imports
try:
    import clr
    clr.AddReference('ProtoGeometry')
    from Autodesk.DesignScript.Geometry import Point as DSPoint
    from Autodesk.DesignScript.Geometry import Line, PolyCurve
except Exception as e:
    OUT = [["ERROR importing Dynamo geometry: {}".format(e)], {}, [], [], [], [], [], {}, 0, 0, None]
    raise

path = IN[0] if len(IN)>0 else None
messages=[]

def fail(msg):
    return [msg], {}, [], [], [], [], [], {}, 0, 0, None

def to_float(x):
    try:
        # Handle numpy types or anything convertible
        return float(x)
    except:
        return None

def coerce_point_list(raw):
    """Return list of (x,y,z) floats or []"""
    pts=[]
    if not raw: return pts
    for r in raw:
        try:
            if isinstance(r,(list,tuple)) and len(r)>=3:
                x=to_float(r[0]); y=to_float(r[1]); z=to_float(r[2])
                if None not in (x,y,z):
                    pts.append((x,y,z))
        except:
            pass
    return pts

def make_ds_points(pt_tuples):
    ds=[]
    for p in pt_tuples:
        try:
            ds.append(DSPoint.ByCoordinates(p[0],p[1],p[2]))
        except:
            ds.append(None)
    return ds

def build_polycurve(ds_pts):
    # Filter None & duplicates
    clean=[]
    last=None
    for p in ds_pts:
        if p and (last is None or p.DistanceTo(last)>1e-10):
            clean.append(p); last=p
    if len(clean)<2:
        return None
    try:
        lines=[]
        for i in range(len(clean)-1):
            a=clean[i]; b=clean[i+1]
            if a.DistanceTo(b)>1e-10:
                lines.append(Line.ByStartPointEndPoint(a,b))
        if not lines:
            return None
        return PolyCurve.ByJoinedCurves(lines)
    except:
        return None

if not path or not isinstance(path,str) or path.strip()=="":
    OUT = fail("No file path provided.")
else:
    path=path.strip('"').strip()
    if not os.path.exists(path):
        OUT = fail("File not found: {}".format(path))
    else:
        try:
            with open(path,'r') as f:
                raw = json.load(f)
        except Exception as e:
            OUT = fail("JSON load error: {}".format(e))
        else:
            meta={}
            results=[]
            # Schema detection
            if isinstance(raw, dict) and "results" in raw:
                meta = raw.get("meta", {})
                results = raw.get("results", [])
            elif isinstance(raw, list):
                results = raw
                meta = {}
            elif isinstance(raw, dict):
                # Possibly dict keyed by element_id; separate meta if present
                meta = raw.get("meta", {})
                # Build list from numeric/string keys excluding 'meta'
                for k,v in raw.items():
                    if k=="meta": continue
                    if isinstance(v, dict):
                        rec = v.copy()
                        rec.setdefault("element_id", k)
                        results.append(rec)
            else:
                OUT = fail("Unrecognized JSON structure.")
                sys.exit()

            element_ids_str=[]
            element_ids_int=[]
            lengths=[]
            path_points_ds=[]
            path_poly=[]
            id_to_length={}
            success=0
            failure=0

            for idx,res in enumerate(results):
                if not isinstance(res, dict):
                    messages.append("Skipping non-dict result at index {}".format(idx))
                    failure+=1
                    element_ids_str.append(None); element_ids_int.append(None)
                    lengths.append(None); path_points_ds.append([]); path_poly.append(None)
                    continue
                eid_raw = res.get("element_id", res.get("id", None))
                # Convert element id to string
                eid_str = str(eid_raw) if eid_raw is not None else "None"
                try:
                    eid_int = int(eid_raw)
                except:
                    eid_int = None
                length = res.get("length", res.get("path_length", None))
                if length is not None:
                    length = to_float(length)
                # Find path coordinates (try multiple keys)
                coord_keys = ["vertex_path_xyz","path_xyz","path","points","coords"]
                coord_data = None
                for k in coord_keys:
                    if k in res:
                        coord_data = res[k]
                        break
                pts = coerce_point_list(coord_data)
                ds_pts = make_ds_points(pts)
                poly = build_polycurve(ds_pts)

                element_ids_str.append(eid_str)
                element_ids_int.append(eid_int)
                lengths.append(length)
                path_points_ds.append(ds_pts)
                path_poly.append(poly)
                id_to_length[eid_str]=length

                if length is not None and poly:
                    success+=1
                else:
                    failure+=1
                    if length is None:
                        messages.append("No length for element_id {}".format(eid_str))
                    if not poly:
                        messages.append("No polycurve for element_id {} (pts={})".format(eid_str, len(ds_pts)))

            # Attempt merged polycurve (all segments)
            merged_poly=None
            try:
                all_lines=[]
                for pc in path_poly:
                    if pc:
                        # Decompose polycurve into lines
                        try:
                            sub_curves=pc.Curves()
                            for sc in sub_curves:
                                all_lines.append(sc)
                        except:
                            all_lines.append(pc)
                if all_lines:
                    merged_poly = PolyCurve.ByJoinedCurves(all_lines)
            except Exception as e:
                messages.append("Merged polycurve creation failed: {}".format(e))
                merged_poly=None

            messages.insert(0, "Loaded {} result records. Success: {} Failure: {}".format(len(results), success, failure))
            OUT = [
                messages,           # 0
                meta,               # 1
                element_ids_str,    # 2
                element_ids_int,    # 3
                lengths,            # 4
                path_points_ds,     # 5
                path_poly,          # 6
                id_to_length,       # 7 (string keys to avoid Int64 cast issues)
                success,            # 8
                failure,            # 9
                merged_poly         # 10
            ]
# ----------------------------------------
code_block = CodeBlock { [2]; [6]; }
getItemAtIndex = List.GetItemAtIndex(list=python_script, index=code_block.out1)
geomPreview = GeomPreviewNodeModel(Geometry=getItemAtIndex, SliderValue=255, rValue="255", gValue="9", bValue="38")
file_path_2 = Filename(".\topologic.JSON")
python_script_2 = Python(IN[0]=file_path_2)  # CPython3
# ---------- python_script_2.python (126 lines) ----------
# Dynamo Python: Visualize topologic.JSON (graph export from pyRevit script)
# Compatible with IronPython2 and CPython3.
#
# IN[0] : path (string) to topologic.JSON
#
# OUT:
#   0 -> Status / Messages
#   1 -> DS Points (vertices) list
#   2 -> DS Lines (edges) list (Line.ByStartPointEndPoint)
#   3 -> End Point (DS Point or None)
#   4 -> Start Points (list of DS Points in same order as start_points array)
#   5 -> Start Point Element IDs (parallel list of element_id)
#   6 -> Meta dictionary (if present)
#   7 -> Vertex Count
#   8 -> Edge Count
#   9 -> Mapping (vertex index -> Point) (list)
#
# Notes:
# - Assumes coordinates are in Revit internal units (feet). No unit conversion performed.
# - Handles absence of meta gracefully.
# - If JSON contains duplicate vertices (rare), returns them as-is.
#
import json, os, sys, traceback

# Dynamo geometry imports (works in both engines)
try:
    import clr
    clr.AddReference('ProtoGeometry')
    from Autodesk.DesignScript.Geometry import Point as DSPoint
    from Autodesk.DesignScript.Geometry import Line
except Exception as e:
    OUT = ["ERROR: Could not import Dynamo geometry: {}".format(e)], [], [], None, [], [], {}, 0, 0, []
    raise

path = IN[0] if len(IN) > 0 else None
messages = []

def fail(msg):
    return [msg], [], [], None, [], [], {}, 0, 0, []

if not path or not isinstance(path, str) or path.strip()=="":
    OUT = fail("No file path provided for topologic.JSON.")
else:
    path = path.strip('"').strip()
    if not os.path.exists(path):
        OUT = fail("File not found: {}".format(path))
    else:
        try:
            with open(path, 'r') as f:
                data = json.load(f)
            vertices = data.get("vertices", [])
            edges = data.get("edges", [])
            start_points_raw = data.get("start_points", [])
            end_pt_raw = data.get("end_point", None)
            meta = data.get("meta", {})

            # Build DS Points
            ds_vertices = []
            for v in vertices:
                try:
                    ds_vertices.append(DSPoint.ByCoordinates(float(v[0]), float(v[1]), float(v[2])))
                except:
                    ds_vertices.append(None)
                    messages.append("Vertex conversion failed for: {}".format(v))

            # Build DS Lines (edges reference indices)
            ds_edges = []
            for e in edges:
                try:
                    a, b = int(e[0]), int(e[1])
                    if 0 <= a < len(ds_vertices) and 0 <= b < len(ds_vertices):
                        pa = ds_vertices[a]; pb = ds_vertices[b]
                        if pa and pb:
                            ds_edges.append(Line.ByStartPointEndPoint(pa, pb))
                        else:
                            messages.append("Null vertex in edge {} -> skipped".format(e))
                    else:
                        messages.append("Edge index out of range: {}".format(e))
                except Exception as ex:
                    messages.append("Edge parse error {} : {}".format(e, ex))

            # Start points
            sp_points = []
            sp_ids = []
            for sp in start_points_raw:
                try:
                    p = sp.get("point")
                    eid = sp.get("element_id")
                    if p and len(p) == 3:
                        sp_points.append(DSPoint.ByCoordinates(float(p[0]), float(p[1]), float(p[2])))
                    else:
                        sp_points.append(None)
                        messages.append("Invalid start point coords: {}".format(p))
                    sp_ids.append(eid)
                except Exception as ex:
                    messages.append("Start point conversion error: {}".format(ex))
                    sp_points.append(None)
                    sp_ids.append(None)

            # End point
            end_pt = None
            if end_pt_raw and len(end_pt_raw) == 3:
                try:
                    end_pt = DSPoint.ByCoordinates(float(end_pt_raw[0]), float(end_pt_raw[1]), float(end_pt_raw[2]))
                except Exception as ex:
                    messages.append("End point conversion error: {}".format(ex))

            messages.insert(0, "Loaded topologic.JSON successfully.")
            messages.append("Vertices: {} | Edges: {} | StartPoints: {}"
                            .format(len(vertices), len(edges), len(sp_points)))

            OUT = [
                messages,          # 0
                ds_vertices,       # 1
                ds_edges,          # 2
                end_pt,            # 3
                sp_points,         # 4
                sp_ids,            # 5
                meta,              # 6
                len(vertices),     # 7
                len(edges),        # 8
                ds_vertices        # 9 (simple mapping list)
            ]
        except Exception as e:
            tb = traceback.format_exc()
            OUT = fail("Failed parsing JSON: {}\n{}".format(e, tb))
# ----------------------------------------
getItemAtIndex_2 = List.GetItemAtIndex(list=python_script_2, index=code_block.out0)
geomPreview_2 = GeomPreviewNodeModel(Geometry=getItemAtIndex_2, SliderValue=255, rValue="27", gValue="255", bValue="57")
categories = Categories("OST_CableTrayFitting")  # frozen
all_elements_of_category = ElementsOfCategory(Category=categories)  # frozen
location = archilab.Revit.Elements.Elements.Location(element=all_elements_of_category)
flatten = List.Flatten(list=location.Point)
geomPreview_3 = GeomPreviewNodeModel(Geometry=flatten, SliderValue=255, rValue="255", gValue="14", bValue="50")
file_path_3 = Filename("..\..\Development.panel\DEV.pulldown\Get Fitting Point.pushbutton\CableTrayFittingPoints.json")  # frozen
python_script_3 = Python(IN[0]=file_path_3)  # CPython3
# ---------- python_script_3.python (30 lines) ----------
import json
import os
import clr

# Import Revit geometry library
clr.AddReference('RevitNodes')
import Revit
clr.ImportExtensions(Revit.GeometryConversion)

clr.AddReference('ProtoGeometry')
from Autodesk.DesignScript.Geometry import Point

# Input: path to JSON file
json_path = IN[0]

# Read and parse JSON
points = []
if os.path.exists(json_path):
    with open(json_path, 'r') as f:
        data = json.load(f)
        for pt in data:
            x = pt.get('X', 0)
            y = pt.get('Y', 0)
            z = pt.get('Z', 0)
            points.append(Point.ByCoordinates(x, y, z))
else:
    points = ["❌ File not found: {}".format(json_path)]

# Output: list of Dynamo Point objects
OUT = points
# ----------------------------------------
geomPreview_4 = GeomPreviewNodeModel(Geometry=python_script_3, SliderValue=255, rValue="255", gValue="16", bValue="54")
