# Dynamo graph Check results.dyn (Dynamo 3.5.2.8914)

file_path = Filename("C:\WWT Tools.extension\revit-mcp-python.extension\WWT Tools.tab\Development.panel\DEV.pulldown\Cable Length Calculation.pushbutton\topologic_results.json")
python_script = Python(IN[0]=file_path)  # CPython3
# ---------- python_script.python (45 lines) ----------
# Dynamo Python Script: Topologic Cable Path Results Reader
# Reads topologic_results.json and outputs three separate outputs for Dynamo node:
#   OUT[0]: list of Element IDs
#   OUT[1]: list of Path Lengths
#   OUT[2]: list of Path Edges (list of [start, end] pairs)
# Author: JacksonPinto

import json
import os

def path_to_edges(path_xyz):
    """Convert a list of points into a list of edges (pairs of points)."""
    edges = []
    for i in range(len(path_xyz)-1):
        pt1 = path_xyz[i]
        pt2 = path_xyz[i+1]
        edges.append([pt1, pt2])
    return edges

# --- Dynamo Input ---
jsonFilePath = IN[0]

if not os.path.exists(jsonFilePath):
    raise Exception("File does not exist: {}".format(jsonFilePath))

with open(jsonFilePath, 'r') as f:
    results = json.load(f)

element_ids = []
path_lengths = []
path_edges = []

for res in results:
    eid = res.get("element_id")
    length = res.get("length")
    path_xyz = res.get("vertex_path_xyz", [])
    element_ids.append(eid)
    path_lengths.append(length)
    if path_xyz and len(path_xyz) > 1:
        path_edges.append(path_to_edges(path_xyz))
    else:
        path_edges.append([])

# --- 3 SEPARATE OUTPUTS for Dynamo ---
OUT = element_ids, path_lengths, path_edges
# ----------------------------------------
code_block = CodeBlock { [0]; [1]; [2]; }
getItemAtIndex = List.GetItemAtIndex(list=python_script, index=code_block.out0)
getItemAtIndex_2 = List.GetItemAtIndex(list=python_script, index=code_block.out1)
getItemAtIndex_3 = List.GetItemAtIndex(list=python_script, index=code_block.out2)
